# Grasshopper definition DC WSII 001 (Point).gh (Grasshopper 1.0.7)

number_slider = Slider(10, range=-10..10)
pt = ConstructPoint(XCoordinate=0, YCoordinate=number_slider, ZCoordinate=0)
pt_2 = ConstructPoint(XCoordinate=number_slider, YCoordinate=0, ZCoordinate=0)
ln = Line(StartPoint=pt_2, EndPoint=pt)
panel = Panel(pt)
panel_2 = Panel(pt_2)
