# Grasshopper definition DC WSII 002 (lists).gh (Grasshopper 1.0.7)

crv = Curve([<curve referenced from the Rhino model> x3])
dom = ConstructDomain(DomainStart=Slider(-10, range=-10..10), DomainEnd=Slider(8.602, range=-10..10))
series = Series(Start=Slider(0, range=0..1), Step=Slider(1, range=0..1), Count=Slider(10, range=0..20))
item = ListItem(List=crv, Index=Slider(0, range=0..2), Wrap=True)
range = Range(Domain=dom, Steps=Slider(10, range=0..20))
panel = Panel(crv)
pt = ConstructPoint(XCoordinate=series, YCoordinate=0, ZCoordinate=0)
