# Grasshopper definition DC WSII 003 (Plane Trimmed with Solids at Points).gh (Grasshopper 1.0.7)

number_slider = Slider(0, range=0..1)
number_slider_2 = Slider(1, range=0..1)
number_slider_3 = Slider(6, range=0..20)
crv = Curve([<curve referenced from the Rhino model> x3])
dom = ConstructDomain(DomainStart=Slider(-10, range=-10..10), DomainEnd=Slider(-1.037, range=-10..10))
multiplication = Multiplication(A=number_slider_2, B=number_slider_3)
item = ListItem(List=crv, Index=Slider(0, range=0..2), Wrap=True)
series = Series(Start=number_slider, Step=number_slider_2, Count=number_slider_3)
range = Range(Domain=dom, Steps=Slider(4, range=0..20))
dom_2 = ConstructDomain(DomainStart=number_slider, DomainEnd=multiplication)
long = LongestList(ListA=series, ListB=range, PaddingMode=2)  # -> ListA, ListB
short = ShortestList(ListA=series, ListB=range, TrimMode=2)  # -> ListA, ListB
crossref = CrossReference(ListA=series, ListB=range, CrossMode=1)  # -> ListA, ListB
panel = Panel(crv)
rectangle = Rectangle(Plane=PlaneXY(0, 0, 0), XSize=dom_2, YSize=dom, Radius=0)  # -> Rectangle, Length
pt = ConstructPoint(XCoordinate=short.ListA, YCoordinate=short.ListB, ZCoordinate=0)
pt_2 = ConstructPoint(XCoordinate=crossref.ListA, YCoordinate=crossref.ListB, ZCoordinate=0)
srf = Surface(rectangle.Rectangle)
sph = Sphere(Base=pt_2, Radius=Slider(0.366, range=0..1))
trim = TrimSolid(Shape=srf, Cutters=sph)
