# Grasshopper definition DC WSII 004 (Loft and Reparamatize).gh (Grasshopper 1.0.7)

number_slider = Slider(8, range=0..10)
number_slider_2 = Slider(0.304, range=0..1)
crv = Curve(<curve referenced from the Rhino model>)
crv_2 = Curve(<curve referenced from the Rhino model>)
eval = EvaluateCurve(Curve=reparameterize(crv_2), Parameter=number_slider_2)  # -> Point, Tangent, Angle
divide = DivideCurve(Curve=crv_2, Count=number_slider, Kinks=False)  # -> Points, Tangents, Parameters
divide_2 = DivideCurve(Curve=crv, Count=number_slider, Kinks=False)  # -> Points, Tangents, Parameters
eval_2 = EvaluateCurve(Curve=reparameterize(crv), Parameter=number_slider_2)  # -> Point, Tangent, Angle
loft = Loft(Curves=[crv_2, crv], Options={Adjust=False, Closed=False, LoftEnds=0, LoftSimp=0, LoftType=0, Rebuild=10, Refit=0.01})  # disabled
ln = Line(StartPoint=divide.Points, EndPoint=divide_2.Points)
ln_2 = Line(StartPoint=eval.Point, EndPoint=eval_2.Point)
panel = Panel(crv_2)
