# Grasshopper definition DC WSII 005 (Transformations).gh (Grasshopper 1.0.7)

number_slider = Slider(7, range=0..10)
crv = Curve(<curve referenced from the Rhino model>)
crv_2 = Curve(<curve referenced from the Rhino model>)
end = EndPoints(Curve=crv)  # -> Start, End
rad = Radians(Degrees=Slider(220, range=0..1000))
vec = VectorXYZ(XComponent=number_slider, YComponent=0, ZComponent=0)  # -> Vector, Length
vec_2 = VectorXYZ(XComponent=number_slider, YComponent=Slider(7, range=0..10), ZComponent=Slider(4, range=0..10))  # -> Vector, Length
rotate = Rotate(Geometry=crv_2, Angle=rad, Plane=vec.Vector)  # -> Geometry, Transform
vec2pt = Vector2Pt(PointA=end.Start, PointB=end.End, Unitize=False)  # -> Vector, Length
move = Move(Geometry=crv, Motion=vec2pt.Vector)  # -> Geometry, Transform
vlen = VectorLength(Vector=unitize(vec2pt.Vector))
arrpolar = PolarArray(Geometry=crv_2, Plane=vec.Vector, Count=Slider(9, range=0..20), Angle=rad)  # -> Geometry, Transform
panel = Panel(vlen)
arrlinear = LinearArray(Geometry=crv, Direction=vec_2.Vector, Count=Slider(5, range=0..10))  # -> Geometry, Transform
