# Grasshopper definition DC WSII 006 (Looking at Data Structures).gh (Grasshopper 1.0.7)

crv = Curve(graft([<curve referenced from the Rhino model> x3]))
crv_2 = Curve(graft([<curve referenced from the Rhino model> x3]))
crv_3 = Curve([<curve referenced from the Rhino model> x3])
crv_4 = Curve([<curve referenced from the Rhino model> x3])
crv_5 = Curve([<curve referenced from the Rhino model> x3])
item = ListItem(List=crv_3, Index=0, Wrap=True)
divide = DivideCurve(Curve=crv_5, Count=10, Kinks=False)  # -> Points, Tangents, Parameters
divide_2 = DivideCurve(Curve=crv_4, Count=10, Kinks=False)  # -> Points, Tangents, Parameters
loft = Loft(Curves=[crv_2, crv], Options={Adjust=False, Closed=False, LoftEnds=0, LoftSimp=0, LoftType=0, Rebuild=10, Refit=0.01})  # disabled
series = Series(Start=0, Step=Slider(5, range=0..10), Count=10)
ln = Line(StartPoint=divide_2.Points, EndPoint=divide.Points)
pt = ConstructPoint(XCoordinate=graft(series), YCoordinate=series, ZCoordinate=0)
panel = Panel(crv_2)
viewer = ParamViewer(crv_2)
viewer_2 = ParamViewer(divide.Points)
viewer_3 = ParamViewer(crv_2)
viewer_4 = ParamViewer(divide_2.Points)
viewer_5 = ParamViewer(pt)
