# Grasshopper definition DC WSII 007 (Surfaces).gh (Grasshopper 1.0.7)

crv = Curve([<curve referenced from the Rhino model> x2])
md_slider = MDSlider(
    SliderMode=0,
    slider_value=Point(0.460975647, 0.6756098677, 0.5),
    x_domain=Domain(0, 1),
    y_domain=Domain(0, 1),
    z_domain=Domain(0, 1))
loft = Loft(Curves=crv, Options={Adjust=False, Closed=False, LoftEnds=0, LoftSimp=0, LoftType=0, Rebuild=10, Refit=0.01})
vec = VectorXYZ(XComponent=Slider(0.498, range=0..1), YComponent=Slider(0.506, range=0..1), ZComponent=0)  # -> Vector, Length
sdivide = DivideSurface(Surface=loft, UCount=Slider(6, range=0..10), VCount=Slider(6, range=0..10))  # -> Points, Normals, Parameters
evalsrf = EvaluateSurface(Surface=reparameterize(loft), Point=md_slider)  # -> Point, Normal, UDirection, VDirection, Frame
pt = Point(<point referenced from the Rhino model>)
dist = Distance(PointA=sdivide.Points, PointB=pt)
one_over_x = OneOverX(Value=dist)
bnd = Bounds(Numbers=flatten(one_over_x))
dom = ConstructDomain(DomainStart=Slider(65, range=0..100), DomainEnd=Slider(57, range=0..100))
remap = RemapNumbers(Value=one_over_x, Source=bnd, Target=dom)  # -> Mapped, Clipped
line = LineSDL(Start=sdivide.Points, Direction=sdivide.Normals, Length=remap.Mapped)
pipe = Pipe(Curve=line, Radius=1, Caps=0)
