# Grasshopper definition DC WSII 008 (Attractor Points to Plane) Tricky.gh (Grasshopper 1.0.7)

number_slider = Slider(50, range=0..50)
dom = ConstructDomain(DomainStart=0, DomainEnd=Slider(100, range=0..100))
pt = Point([<point referenced from the Rhino model> x6])
range = Range(Domain=dom, Steps=number_slider)
series = Series(Start=0, Step=Slider(23, range=0..100), Count=Slider(10, range=0..20))
expression = Expression(x=number_slider, Expression="x+1")
pt_2 = ConstructPoint(XCoordinate=graft(range), YCoordinate=range, ZCoordinate=0)  # -> flatten(Point)
dist = Distance(PointA=pt_2, PointB=graft(pt))
flip = FlipMatrix(Data=dist)
Z = UnitZ(Factor=1)
ma = MassMultiplication(Input=flip)  # -> flatten(Result), PartialResults
bnd = Bounds(Numbers=ma.Result)
dom_2 = ConstructDomain(DomainStart=0, DomainEnd=Slider(200, range=0..200))
remap = RemapNumbers(Value=ma.Result, Source=bnd, Target=dom_2)  # -> Mapped, Clipped
line = LineSDL(Start=pt_2, Direction=Z, Length=remap.Mapped)
end = EndPoints(Curve=line)  # -> Start, End
srfgrid = SurfaceFromPoints(Points=flatten(end.End), UCount=expression, Interpolate=False)
