# Grasshopper definition DC WSII 009 (expressions and Functions).gh (Grasshopper 1.0.7)

number_slider = Slider(3, range=0..100)
random = Random(Range=Domain(0, 1), Number=number_slider, Seed=2)
random_2 = Random(Range=Domain(0, 1), Number=Slider(17, range=0..100), Seed=2)
random_3 = Random(Range=Domain(0, 1), Number=number_slider, Seed=Slider(5, range=0..10))
expression = Expression(x="Hello", y="World", Expression="Format(\"{0}, {1}\", x, y)")
expression_2 = Expression(x=random, y=random_3, Expression="x/y*x^2/y^2")
expression_3 = Expression(x=random_2, y=Slider(4, range=0..10), Expression="Round(x,y)")
expression_4 = Expression(x=random, y=random_3, Expression="Max(x,y)")
panel = Panel(expression_2)
panel_2 = Panel(random)
panel_3 = Panel(random_3)
panel_4 = Panel(expression)
