# Grasshopper definition DC WSII A (Hand tool).gh (Grasshopper 1.0.7)

# ----
# How do we get this to map onto verticle?
# We construct a curve in Rhino
crv = Curve(<curve referenced from the Rhino model>)

crv_2 = Curve(<curve referenced from the Rhino model>)

# ---- group: Reparamatize fore every request
# Initial stage of 2D geometry
vpipe = PipeVariable(
    Curve=reparameterize(crv),
    Parameters=[Slider(0.25, range=0..1), Slider(0, range=0..1), Slider(0.5, range=0..1), Slider(0.872, range=0..1), Slider(1, range=0..1)],
    Radii=[Slider(3, range=0..12), Slider(5, range=0..12), Slider(3, range=0..12), Slider(5, range=0..12), Slider(2, range=0..12)],
    Caps=0)

vpipe_2 = PipeVariable(
    Curve=reparameterize(crv_2),
    Parameters=[Slider(0.25, range=0..1), Slider(0, range=0..1), Slider(0.296, range=0..1), Slider(0.656, range=0..1), Slider(0.888, range=0..1)],
    Radii=[Slider(4, range=0..12), Slider(6, range=0..12), Slider(5, range=0..12), Slider(8, range=0..12), Slider(0, range=0..12)],
    Caps=0)

# ---- group: Tri Grid (Flatten)
trigrid = Triangular(Plane=PlaneXY(0, 0, 0), Size=1, ExtentX=Slider(20, range=0..20), ExtentY=Slider(10, range=0..10))  # -> flatten(Cells), Points

trigrid_2 = Triangular(Plane=PlaneXY(0, 0, 0), Size=1, ExtentX=Slider(20, range=0..20), ExtentY=Slider(10, range=0..10))  # -> flatten(Cells), Points

# ----
bbox = BoundingBox(Content=trigrid.Cells, Plane=PlaneXY(0, 0, 0), UnionBox=True)  # -> Box, Box_2
bbox_2 = BoundingBox(Content=trigrid_2.Cells, Plane=PlaneXY(0, 0, 0), UnionBox=True)  # -> Box, Box_2
map_srf = MapToSurface(Curve=flatten(trigrid.Cells), Source=bbox.Box, Target=vpipe)
map_srf_2 = MapToSurface(Curve=flatten(trigrid_2.Cells), Source=bbox_2.Box, Target=vpipe_2)
sph = Sphere(Base=PlaneXY(0, 0, 0), Radius=Slider(6, range=0..10))
sph_2 = Sphere(Base=PlaneXY(0, 0, 0), Radius=Slider(6, range=0..10))
boundary = BoundarySurfaces(Edges=map_srf)
boundary_2 = BoundarySurfaces(Edges=map_srf_2)
brep = Brep(sph)
brep_2 = Brep(boundary)
brep_3 = Brep(sph_2)
brep_4 = Brep(boundary_2)
neg = Negative(Value=Slider(57, range=0..100))
sunion = SolidUnion(Breps=[brep_2, brep])
Z = UnitZ(Factor=neg)
sunion_2 = SolidUnion(Breps=[brep_4, brep_3])
move = Move(Geometry=sunion, Motion=Z)  # -> Geometry, Transform
viewer = ParamViewer(sunion_2)
viewer_2 = ParamViewer(move.Geometry)
brep_5 = Brep(move.Geometry)
brep_6 = Brep(sunion_2)
cap = CapHoles(Brep=brep_6)
cap_2 = CapHoles(Brep=brep_5)
sunion_3 = SolidUnion(Breps=[cap_2, cap])
