# Grasshopper definition DC WSII A (Objects projected on tower).gh (Grasshopper 1.0.7)

# ----
# How do we get this to map onto verticle?
# We construct a curve in Rhino
crv = Curve(<curve referenced from the Rhino model>)

# ---- group: Reparamatize fore every request
vpipe = PipeVariable(
    Curve=reparameterize(crv),
    Parameters=[Slider(0.2, range=0..1), Slider(0, range=0..1), Slider(0.544, range=0..1), Slider(0.851, range=0..1), Slider(1, range=0..1)],
    Radii=[Slider(6, range=0..30), Slider(9, range=0..30), Slider(7, range=0..30), Slider(4, range=0..30), Slider(13, range=0..30)],
    Caps=0)

# ---- group: Tri Grid (Flatten)
trigrid = Triangular(Plane=PlaneXY(0, 0, 0), Size=1, ExtentX=Slider(11, range=0..20), ExtentY=Slider(3, range=0..10))  # -> flatten(Cells), Points

# ----
bbox = BoundingBox(Content=trigrid.Cells, Plane=PlaneXY(0, 0, 0), UnionBox=True)  # -> Box, Box_2
map_srf = MapToSurface(Curve=trigrid.Cells, Source=bbox.Box, Target=vpipe)
number_slider = Slider(1, range=0..1)  # disabled
pt = ConstructPoint(XCoordinate=0, YCoordinate=0, ZCoordinate=number_slider)  # disabled
neg = Negative(Value=pt)  # disabled
number_slider_2 = Slider(0.678, range=0..1)
neg_2 = Negative(Value=number_slider_2)

# ----
# Initial stage of 2D geometry
number_slider_3 = Slider(3, range=0..10)  # disabled
polygon = Polygon(Plane=PlaneXY(0, 0, 0), Radius=3, Segments=number_slider_3, FilletRadius=0)  # -> Polygon, Length; disabled
explode = Explode(Curve=polygon.Polygon, Recursive=True)  # -> Segments, Vertices; disabled
# Move top down (cut and paste for this learning program and disable initial geometry above)
explode_2 = Explode(Curve=explode.Segments, Recursive=True)  # -> Segments, Vertices; disabled
avr = Average(Input=explode_2.Vertices)  # disabled
number_slider_4 = Slider(0.421, range=0..1)  # disabled

# ---- group: Trick -1 in index i
cull_i = CullIndex(List=explode.Vertices, Indices=-1, Wrap=True)  # disabled

# ---- group: less heavy component
avr_2 = Average(Input=cull_i)  # disabled

# ----
ln = Line(StartPoint=avr_2, EndPoint=avr)  # disabled

# ---- group: reparamatize
eval = EvaluateCurve(Curve=reparameterize(ln), Parameter=number_slider_4)  # -> Point, Tangent, Angle; disabled

# ---- group: connect moving points to main verticies
ln_2 = Line(StartPoint=eval.Point, EndPoint=explode_2.Vertices)  # disabled

# ---- group: deconstructs Hierarchy
pshift = ShiftPaths(Data=ln_2, Offset=-1)  # disabled

# ---- group: makes multi curves 1 curve
join = JoinCurves(Curves=pshift, Preserve=False)  # disabled

# ----
extr = ExtrudePoint(Base=join, Point=[neg, pt])  # disabled

# ---- group: 3D Geometry
brep = Brep(extr)  # disabled

# ----
# Initial stage of 2D geometry
number_slider_5 = Slider(3, range=0..10)
polygon_2 = Polygon(Plane=PlaneXY(0, 0, 0), Radius=3, Segments=number_slider_5, FilletRadius=0)  # -> Polygon, Length
explode_3 = Explode(Curve=map_srf, Recursive=True)  # -> Segments, Vertices
explode_4 = Explode(Curve=explode_3.Segments, Recursive=True)  # -> Segments, Vertices
avr_3 = Average(Input=explode_4.Vertices)
number_slider_6 = Slider(0.655, range=0..1)

# ---- group: Trick -1 in index i
cull_i_2 = CullIndex(List=explode_3.Vertices, Indices=-1, Wrap=True)

# ---- group: less heavy component
avr_4 = Average(Input=cull_i_2)

# ---- group: Last but not least
crv_cp = CurveClosestPoint(Point=avr_4, Curve=crv)  # -> Point, Parameter, Distance
dom = ConstructDomain(DomainStart=Slider(0.172, range=0..1), DomainEnd=Slider(0.857, range=0..1))
bnd = Bounds(Numbers=flatten(crv_cp.Distance))
remap = RemapNumbers(Value=crv_cp.Distance, Source=bnd, Target=dom)  # -> Mapped, Clipped

# ----
pshift_2 = ShiftPaths(Data=avr_3, Offset=-1)

ln_3 = Line(StartPoint=avr_4, EndPoint=pshift_2)

# ---- group: reparamatize
eval_2 = EvaluateCurve(Curve=reparameterize(ln_3), Parameter=remap.Mapped)  # -> Point, Tangent, Angle

# ---- group: connect moving points to main verticies
ln_4 = Line(StartPoint=graft(eval_2.Point), EndPoint=explode_4.Vertices)

# ---- group: deconstructs Hierarchy
pshift_3 = ShiftPaths(Data=ln_4, Offset=-1)

# ---- group: makes multi curves 1 curve
join_2 = JoinCurves(Curves=pshift_3, Preserve=False)

# ----
viewer = ParamViewer(join_2)

# ---- group: The Difficult Shit
srf_cp = SurfaceClosestPoint(Point=avr_4, Surface=vpipe)  # -> Point, UVPoint, Distance
evalsrf = EvaluateSurface(Surface=vpipe, Point=srf_cp.UVPoint)  # -> Point, Normal, UDirection, VDirection, Frame
deplane = DeconstructPlane(Plane=evalsrf.Frame)  # -> Origin, XAxis, YAxis, ZAxis

# ----
amp = Amplitude(Vector=deplane.ZAxis, Amplitude=[neg_2, number_slider_2])

# ---- group: The Difficult Shit (continued)
move = Move(Geometry=avr_4, Motion=amp)  # -> Geometry, Transform

# ----
extr_2 = ExtrudePoint(Base=join_2, Point=move.Geometry)
viewer_2 = ParamViewer(move.Geometry)

# ---- group: 3D Geometry
brep_2 = Brep(extr_2)
