# Grasshopper definition DC WSII A001 (Wheel on Tower).gh (Grasshopper 1.0.7)

number_slider = Slider(0, range=0..1)  # disabled
number_slider_2 = Slider(6, range=0..30)  # disabled
number_slider_3 = Slider(0.2, range=0..1)  # disabled
number_slider_4 = Slider(0.544, range=0..1)  # disabled
number_slider_5 = Slider(0.851, range=0..1)  # disabled
number_slider_6 = Slider(1, range=0..1)  # disabled
number_slider_7 = Slider(9, range=0..30)  # disabled
number_slider_8 = Slider(7, range=0..30)  # disabled
number_slider_9 = Slider(4, range=0..30)  # disabled
number_slider_10 = Slider(13, range=0..30)  # disabled
# How do we get this to map onto verticle?
# We construct a curve in Rhino
crv = Curve(<curve referenced from the Rhino model>)  # disabled

number_slider_11 = Slider(11, range=0..20)  # disabled
number_slider_12 = Slider(3, range=0..10)  # disabled
# Double Phase Sine Curve
# Single Phase Sine Curve
number_slider_13 = Slider(8, range=0..100)

# ---- group: Reparamatize fore every request
vpipe = PipeVariable(
    Curve=reparameterize(crv),
    Parameters=[number_slider_3, number_slider, number_slider_4, number_slider_5, number_slider_6],
    Radii=[number_slider_2, number_slider_7, number_slider_8, number_slider_9, number_slider_10],
    Caps=0)  # disabled

# ---- group: Tri Grid (Flatten)
trigrid = Triangular(Plane=PlaneXY(0, 0, 0), Size=1, ExtentX=number_slider_11, ExtentY=number_slider_12)  # -> flatten(Cells), Points; disabled

# ----
cir = Circle(Plane=PlaneXY(0, 0, 0), Radius=Slider(10, range=0..10))
Z = UnitZ(Factor=Slider(50, range=0..100))
pi = Pi(Factor=number_slider_13)
pi_2 = Pi(Factor=number_slider_13)
dom = ConstructDomain(DomainStart=0, DomainEnd=pi)
dom_2 = ConstructDomain(DomainStart=0, DomainEnd=pi_2)
bbox = BoundingBox(Content=trigrid.Cells, Plane=PlaneXY(0, 0, 0), UnionBox=True)  # -> Box, Box_2; disabled
neg = Negative(Value=Z)
divide = DivideCurve(Curve=cir, Count=Slider(6, range=0..10), Kinks=False)  # -> Points, Tangents, Parameters
range = Range(Domain=dom, Steps=Slider(63, range=0..128))
pi_3 = Pi(Factor=Slider(3.576, range=0..4))
range_2 = Range(Domain=dom_2, Steps=Slider(128, range=0..128))
pi_4 = Pi(Factor=Slider(0, range=0..4))
map_srf = MapToSurface(Curve=trigrid.Cells, Source=bbox.Box, Target=vpipe)  # disabled
avr = Average(Input=divide.Points)
expression = Expression(A=Slider(2, range=0..10), t=range, x=pi_3, w=Slider(1, range=0..2), Expression="A*sin(w*t+x)")
expression_2 = Expression(A=Slider(4, range=0..10), t=range_2, x=pi_4, w=Slider(2, range=0..2), Expression="A*sin(w*t+x)")
ln = Line(StartPoint=divide.Points, EndPoint=avr)
number_slider_14 = Slider(1, range=0..1)  # disabled
eval = EvaluateCurve(Curve=reparameterize(ln), Parameter=Slider(0.324, range=0.1..0.9))  # -> Point, Tangent, Angle
pt = ConstructPoint(XCoordinate=range, YCoordinate=0, ZCoordinate=expression)
pt_2 = ConstructPoint(XCoordinate=range_2, YCoordinate=Slider(24, range=0..55), ZCoordinate=expression_2)
pline = PolyLine(Vertices=eval.Point, Closed=Toggle(True))
pt_3 = ConstructPoint(XCoordinate=0, YCoordinate=0, ZCoordinate=number_slider_14)  # disabled
number_slider_15 = Slider(12, range=0..25)
intcrv = Interpolate(Vertices=pt_2, Degree=3, Periodic=False, KnotStyle=1)  # -> Curve, Length, Domain
intcrv_2 = Interpolate(Vertices=pt, Degree=3, Periodic=False, KnotStyle=1)  # -> Curve, Length, Domain
brep = Brep(cir)
brep_2 = Brep(pline)
loft = Loft(
    Curves=[intcrv_2.Curve, intcrv.Curve],
    Options={Adjust=False, Closed=False, LoftEnds=0, LoftSimp=0, LoftType=0, Rebuild=10, Refit=0.01})
neg_2 = Negative(Value=pt_3)  # disabled
neg_3 = Negative(Value=number_slider_15)
sdiff = SolidDifference(BrepsA=brep_2, BrepsB=brep)
geo = Geometry(sdiff)
X = UnitX(Factor=neg_3)
move = Move(Geometry=geo, Motion=neg)  # -> Geometry, Transform
number_slider_16 = Slider(0.678, range=0..1)  # disabled
Y = UnitY(Factor=number_slider_15)
move_2 = Move(Geometry=loft, Motion=X)  # -> Geometry, Transform
neg_4 = Negative(Value=Y)
move_3 = Move(Geometry=move_2.Geometry, Motion=neg_4)  # -> Geometry, Transform
project = Project(Geometry=move.Geometry, Plane=PlaneXY(0, 0, 0))  # -> Geometry, Transform
planesrf = PlaneSurface(Plane=project.Geometry, XSize=Domain(-10, 10), YSize=Domain(-10, 10))
neg_5 = Negative(Value=number_slider_16)  # disabled
rint = RegionIntersection(CurvesA=planesrf)

# ----
# Initial stage of 2D geometry
number_slider_17 = Slider(3, range=0..10)  # disabled
polygon = Polygon(Plane=PlaneXY(0, 0, 0), Radius=3, Segments=number_slider_17, FilletRadius=0)  # -> Polygon, Length; disabled
explode = Explode(Curve=polygon.Polygon, Recursive=True)  # -> Segments, Vertices; disabled
# Move top down (cut and paste for this learning program and disable initial geometry above)
explode_2 = Explode(Curve=explode.Segments, Recursive=True)  # -> Segments, Vertices; disabled
avr_2 = Average(Input=explode_2.Vertices)  # disabled
number_slider_18 = Slider(0.421, range=0..1)  # disabled

# ---- group: Trick -1 in index i
cull_i = CullIndex(List=explode.Vertices, Indices=-1, Wrap=True)  # disabled

# ---- group: less heavy component
avr_3 = Average(Input=cull_i)  # disabled

# ----
ln_2 = Line(StartPoint=avr_3, EndPoint=avr_2)  # disabled

# ---- group: reparamatize
eval_2 = EvaluateCurve(Curve=reparameterize(ln_2), Parameter=number_slider_18)  # -> Point, Tangent, Angle; disabled

# ---- group: connect moving points to main verticies
ln_3 = Line(StartPoint=eval_2.Point, EndPoint=explode_2.Vertices)  # disabled

# ---- group: deconstructs Hierarchy
pshift = ShiftPaths(Data=ln_3, Offset=-1)  # disabled

# ---- group: makes multi curves 1 curve
join = JoinCurves(Curves=pshift, Preserve=False)  # disabled

# ----
extr = ExtrudePoint(Base=join, Point=[neg_2, pt_3])  # disabled

# ---- group: 3D Geometry
brep_3 = Brep(extr)  # disabled

# ----
# Initial stage of 2D geometry
number_slider_19 = Slider(3, range=0..10)  # disabled
polygon_2 = Polygon(Plane=PlaneXY(0, 0, 0), Radius=3, Segments=number_slider_19, FilletRadius=0)  # -> Polygon, Length; disabled
explode_3 = Explode(Curve=map_srf, Recursive=True)  # -> Segments, Vertices; disabled
explode_4 = Explode(Curve=explode_3.Segments, Recursive=True)  # -> Segments, Vertices; disabled
avr_4 = Average(Input=explode_4.Vertices)  # disabled
number_slider_20 = Slider(0.655, range=0..1)  # disabled

# ---- group: Trick -1 in index i
cull_i_2 = CullIndex(List=explode_3.Vertices, Indices=-1, Wrap=True)  # disabled

# ---- group: less heavy component
avr_5 = Average(Input=cull_i_2)  # disabled

# ---- group: Last but not least
number_slider_21 = Slider(0.857, range=0..1)  # disabled
number_slider_22 = Slider(0.172, range=0..1)  # disabled
crv_cp = CurveClosestPoint(Point=avr_5, Curve=crv)  # -> Point, Parameter, Distance; disabled
dom_3 = ConstructDomain(DomainStart=number_slider_22, DomainEnd=number_slider_21)  # disabled
bnd = Bounds(Numbers=flatten(crv_cp.Distance))  # disabled
remap = RemapNumbers(Value=crv_cp.Distance, Source=bnd, Target=dom_3)  # -> Mapped, Clipped; disabled

# ----
pshift_2 = ShiftPaths(Data=avr_4, Offset=-1)  # disabled

ln_4 = Line(StartPoint=avr_5, EndPoint=pshift_2)  # disabled

# ---- group: reparamatize
eval_3 = EvaluateCurve(Curve=reparameterize(ln_4), Parameter=remap.Mapped)  # -> Point, Tangent, Angle; disabled

# ---- group: connect moving points to main verticies
ln_5 = Line(StartPoint=graft(eval_3.Point), EndPoint=explode_4.Vertices)  # disabled

# ---- group: deconstructs Hierarchy
pshift_3 = ShiftPaths(Data=ln_5, Offset=-1)  # disabled

# ---- group: makes multi curves 1 curve
join_2 = JoinCurves(Curves=pshift_3, Preserve=False)  # disabled

# ----
viewer = ParamViewer(join_2)  # disabled

# ---- group: The Difficult Shit
srf_cp = SurfaceClosestPoint(Point=avr_5, Surface=vpipe)  # -> Point, UVPoint, Distance; disabled
evalsrf = EvaluateSurface(Surface=vpipe, Point=srf_cp.UVPoint)  # -> Point, Normal, UDirection, VDirection, Frame; disabled
deplane = DeconstructPlane(Plane=evalsrf.Frame)  # -> Origin, XAxis, YAxis, ZAxis; disabled

# ----
amp = Amplitude(Vector=deplane.ZAxis, Amplitude=[neg_5, number_slider_16])  # disabled

# ---- group: The Difficult Shit (continued)
move_4 = Move(Geometry=avr_5, Motion=amp)  # -> Geometry, Transform; disabled

# ----
extr_2 = ExtrudePoint(Base=join_2, Point=move_4.Geometry)  # disabled
viewer_2 = ParamViewer(move_4.Geometry)  # disabled

# ---- group: 3D Geometry
brep_4 = Brep(extr_2)  # disabled
